% Simulink data dictionary kirov_data.sldd

Environment = Simulink.Bus()
  timestamp: uint32
  V_wind_O: double[3]

State = Simulink.Bus()
  timestamp: uint32
  position_O: double[3], Unit="m"
  velocity_O: double[3], Unit="m/s"
  accel_O: double[3], Unit="m/s^2"
  q: double[4], Unit="1"
  omega_B: double[3], Unit="deg/s"
  alpha_B: double[3], Unit="deg/s^2"

Control = Simulink.Bus()
  timestamp: uint32
  channels: uint16[16]  % PWM from ch1~ch16
  flaps: double[2], Unit="1"
  spoilers: double[2], Unit="deg"
  gear: double, Unit="1"
  steer: double, Unit="deg"
  brakes: double[2], Unit="1"
  L_throttle: double, Unit="1"
  R_throttle: double, Unit="1"
  L_aileron: double, Unit="deg"
  R_aileron: double, Unit="deg"
  elevator: double, Unit="deg"
  rudder: double, Unit="deg"

RCin = Simulink.Bus()
  timestamp: uint32
  throttle: double
  roll: double
  pitch: double
  yaw: double
  gear: uint8  % 0up 1down
  flap: uint8  % 012
  brake: uint8  % 0no 1yes
  spoiler: double